# Dynamo graph 1-Create a schedule to collect IFC parameters.dyn "1-Create a schedule to collect IFC parameters_v2" (Dynamo 3.3.0.6316)

categories = Categories("OST_Walls")
categories_2 = Categories("OST_Windows")
categories_3 = Categories("OST_Doors")
list_create = List.Create(item0=categories, item1=categories_2, item2=categories_3)
code_block = CodeBlock(A=list_create) { A+"_IFC"; }
include_builtinprameters_in_ifc = BoolSelector(false)  # "include BuiltInPrameters in IFC Group"
make_schedule = Python(IN[0]=list_create, IN[1]=code_block, IN[2]=include_builtinprameters_in_ifc)  # CPython3
# ---------- make_schedule.python (96 lines) ----------
import clr

clr.AddReference('RevitAPI')
from Autodesk.Revit.DB import *

clr.AddReference('RevitAPIUI')
from Autodesk.Revit.UI import *

clr.AddReference('System')
from System.Collections.Generic import List
from System import Enum

clr.AddReference('RevitNodes')
import Revit
clr.ImportExtensions(Revit.GeometryConversion)
clr.ImportExtensions(Revit.Elements)

clr.AddReference('RevitServices')
from RevitServices.Persistence import DocumentManager
import RevitServices
from RevitServices.Transactions import TransactionManager


def Unwrap(item):
    result = []
    if isinstance (item, list):
        for i in item:
            result.append(Unwrap(i))
    else:
        result = UnwrapElement(item)
    return result


doc = DocumentManager.Instance.CurrentDBDocument
uidoc=DocumentManager.Instance.CurrentUIApplication.ActiveUIDocument
def Check_IFC_Group(s, doc):
    app = doc.Application
    if (int(app.VersionNumber)>2024):
        return s.Definition.GetGroupTypeId() == GroupTypeId.Ifc
    else:
        return s.Definition.ParameterGroup == BuiltInParameterGroup.PG_IFC
    return 0
#Preparing input from dynamo to revit
if isinstance(IN[0], list):
    categories = [Unwrap(e) for e in IN[0]]
else:
    categories = [Unwrap(IN[0])]

if isinstance(IN[1], list):
    titles = [Unwrap(e) for e in IN[1]]
else:
    titles = [Unwrap(IN[1])]

bool = IN[2]

viewSchedules = FilteredElementCollector(doc).OfCategory(BuiltInCategory.OST_Schedules).ToElements()
#Do some action in a Transaction
outVal = []
TransactionManager.Instance.EnsureInTransaction(doc)

for i, cat in enumerate(categories):
    sEle = FilteredElementCollector(doc).OfCategoryId(cat.Id).WhereElementIsNotElementType().FirstElement()
    if sEle == None:
        continue
    eleParams = [s for s in sEle.Parameters]
    paramId_Type = [s.Id.IntegerValue for s in eleParams if s.Definition.BuiltInParameter == BuiltInParameter.ELEM_TYPE_PARAM]
    paramId_IfcGroup = [s.Id.IntegerValue for s in eleParams if Check_IFC_Group(s, doc)]
    vs = next((v for v in viewSchedules if v.Name == titles[i]),-1)
    if vs == -1:
        vs = ViewSchedule.CreateSchedule(doc, cat.Id)
        vs.Name = titles[i]
    vd = vs.Definition
    sf = vd.GetSchedulableFields() 
    
    for s in sf:
        if s.FieldType != ScheduleFieldType.Instance and s.FieldType != ScheduleFieldType.ElementType:
            continue
        
        if s.ParameterId.IntegerValue in paramId_Type:
            try: 
                vd.AddField(s)
            except:
                continue
        if s.ParameterId.IntegerValue in paramId_IfcGroup:
            if s.ParameterId.IntegerValue < 0 and not bool:   # This will exclude all built in parameter in parametergroup : PG_IFC
                continue
            try: 
                vd.AddField(s)
                
            except:
                continue  
   
    outVal.append(vs)

TransactionManager.Instance.TransactionTaskDone()
OUT = outVal
# ----------------------------------------
