# Dynamo graph 2-Export schedule into excel.dyn (Dynamo 3.3.0.6316)

directory_path = Directory("D:\Events\FY2026\Event-Corenet IFC clinics\S02\Dynamo")
code_block = CodeBlock { "\\IFC.xlsx"; }
code_block_2 = CodeBlock(a=directory_path, b=code_block) { a+b; }
code_block_3 = CodeBlock { "_IFC"; }
python_script = Python(IN[0]=code_block_3)  # CPython3
# ---------- python_script.python (44 lines) ----------
import clr

clr.AddReference('RevitAPI')
from Autodesk.Revit.DB import *

clr.AddReference('RevitAPIUI')
from Autodesk.Revit.UI import *

clr.AddReference('System')
from System.Collections.Generic import List

clr.AddReference('RevitNodes')
import Revit
clr.ImportExtensions(Revit.GeometryConversion)
clr.ImportExtensions(Revit.Elements)

clr.AddReference('RevitServices')
from RevitServices.Persistence import DocumentManager
import RevitServices
from RevitServices.Transactions import TransactionManager


def Unwrap(item):
    result = []
    if isinstance (item, list):
        for i in item:
            result.append(Unwrap(i))
    else:
        result = UnwrapElement(item)
    return result


doc = DocumentManager.Instance.CurrentDBDocument
uidoc=DocumentManager.Instance.CurrentUIApplication.ActiveUIDocument

#Preparing input from dynamo to revit
surfix = IN[0]


#Do some action in a Transaction
schedules = FilteredElementCollector(doc).OfCategory(BuiltInCategory.OST_Schedules).ToElements()
ifcSchedules = [s for s in schedules if surfix in s.Name]

OUT = ifcSchedules
# ----------------------------------------
code_block_4 = CodeBlock(s=python_script) { s.Name; }
code_block_5 = CodeBlock(sheetName=code_block_4) { sheetName; }
code_block_6 = CodeBlock { 0; }
prepare_export_data_v2 = Python(IN[0]=python_script)  # CPython3
# ---------- prepare_export_data_v2.python (82 lines) ----------
import clr

clr.AddReference('RevitAPI')
from Autodesk.Revit.DB import *

clr.AddReference('RevitAPIUI')
from Autodesk.Revit.UI import *

clr.AddReference('System')
from System.Collections.Generic import List

clr.AddReference('RevitNodes')
import Revit
clr.ImportExtensions(Revit.GeometryConversion)
clr.ImportExtensions(Revit.Elements)

clr.AddReference('RevitServices')
from RevitServices.Persistence import DocumentManager
import RevitServices
from RevitServices.Transactions import TransactionManager


def Unwrap(item):
    result = []
    if isinstance (item, list):
        for i in item:
            result.append(Unwrap(i))
    else:
        result = UnwrapElement(item)
    return result


doc = DocumentManager.Instance.CurrentDBDocument
uidoc=DocumentManager.Instance.CurrentUIApplication.ActiveUIDocument

#Preparing input from dynamo to revit
if isinstance(IN[0], list):
    schedules = [Unwrap(e) for e in IN[0]]
else:
    schedules = [Unwrap(IN[0])]
outVal =[]

for sc in schedules:
    #get elements in views
    scheduleData = []
    eleInView = FilteredElementCollector(doc, sc.Id).ToElements()
    definition = sc.Definition
    ids = definition.GetFieldOrder()
    paraSchNames = []
    for id in ids:
        field = definition.GetField(id)
        if field.FieldType  == ScheduleFieldType.Instance or field.FieldType  == ScheduleFieldType.ElementType:
            paraSchNames.append(field.GetName())
            
    #set header
    header = []
    header.append("ElementId")
    header += paraSchNames
    scheduleData.append(header) 
    #get element parameters
    for ele in eleInView:
        eleParaValues = [] 
        eleType = doc.GetElement(ele.GetTypeId())
        eleParaValues.append(ele.Id)
        for paraSchName in paraSchNames:
            paraEle = ele.LookupParameter(paraSchName)
            if paraEle is None:
                paraEle = eleType.LookupParameter(paraSchName)
                
            if paraEle.HasValue:
                eleParaValues.append(paraEle.AsValueString())
            else:
                if paraEle.Definition.GetDataType().TypeId == SpecTypeId.Boolean.YesNo.TypeId:
                    eleParaValues.append(None)
                elif paraEle.StorageType == StorageType.Double or paraEle.StorageType == StorageType.Integer:
                    eleParaValues.append(0)
                else:
                    eleParaValues.append(None)
        scheduleData.append(eleParaValues)
    outVal.append(scheduleData)
    
OUT = outVal
# ----------------------------------------
exportToExcel = Data.ExportToExcel(filePath=code_block_2, sheetName=code_block_5, startRow=code_block_6, startColumn=code_block_6, data=prepare_export_data_v2)
