# Dynamo graph 3-Import excel data to Revit elements.dyn "3-Import excel data to Revit elements_v2.1" (Dynamo 3.3.0.6316)

file_path = Filename(".\IFC.xlsx")
file_from_path = FileObject(path=file_path)
get_excel_sheet_name = Python(IN[0]=file_path)  # CPython3
# ---------- get_excel_sheet_name.python (20 lines) ----------
import sys
import clr
import System
from System import Array
from System.Collections.Generic import List, IList, Dictionary

clr.AddReference('DocumentFormat.OpenXml')
import DocumentFormat
from DocumentFormat.OpenXml import *
from DocumentFormat.OpenXml.Packaging import *
from DocumentFormat.OpenXml.Spreadsheet import *

filepath = IN[0]

spreadsheetDoc = SpreadsheetDocument.Open(filepath, False)
workbookPart = spreadsheetDoc.WorkbookPart
sheetsName = [s.Name.Value for s in spreadsheetDoc.WorkbookPart.Workbook.Sheets]
spreadsheetDoc.Close()

OUT = sheetsName
# ----------------------------------------
windows_form_select_sheet = Python(IN[0]=get_excel_sheet_name)  # CPython3
# ---------- windows_form_select_sheet.python (161 lines) ----------
import clr

clr.AddReference('RevitAPI')
from Autodesk.Revit.DB import *
from Autodesk.Revit.DB.Structure import *

clr.AddReference('RevitAPIUI')
from Autodesk.Revit.UI import *

clr.AddReference('System')
from System.Collections.Generic import List

clr.AddReference('RevitNodes')
import Revit
clr.ImportExtensions(Revit.GeometryConversion)
clr.ImportExtensions(Revit.Elements)

clr.AddReference('RevitServices')
import RevitServices
from RevitServices.Persistence import DocumentManager
from RevitServices.Transactions import TransactionManager

clr.AddReference('System.Windows.Forms')
from System.Windows.Forms import *
clr.AddReference('System.Drawing')
from System.Drawing import *
clr.AddReference('System')
from System import *

clr.AddReference('DSCoreNodes')
from DSCore import Math


doc = DocumentManager.Instance.CurrentDBDocument
uidoc=DocumentManager.Instance.CurrentUIApplication.ActiveUIDocument

#Preparing input from dynamo to revit
if isinstance (IN[0], list):
	sheetList = IN[0]
else:
	sheetList = [IN[0]]


def GetDpiMultiplier():
    graphics = Graphics.FromHwnd(IntPtr.Zero)
    dpi = graphics.DpiX    
    return dpi/96
    
class CustomForm():
    
    def __init__(self):
    
        #class data
        self.data = 'foo'
        self.mul = GetDpiMultiplier()

        self.inputs = []
        #form
        self.form = Form()
        self.form.ShowIcon = False
        self.form.MaximizeBox = False
        self.form.FormBorderStyle = FormBorderStyle.FixedSingle
        #self.form.AutoScaleMode = AutoScaleMode.Dpi
        self.form.Size = Size(400*self.mul,500*self.mul)
        self.form.MinimumSize = Size(400*self.mul,500*self.mul)
        self.form.ClientSize = Size(378*self.mul,444*self.mul)
        self.form.BackColor = Color.DimGray;
  
        #label
        self.label = Label()
        self.label.Parent = self.form
        self.label.Location = Point(12*self.mul,9*self.mul)
        self.label.Size = Size(200*self.mul,25*self.mul)
        self.label.Text = 'Select Sheets'
        
        #checklistBox
        self.chkListBox = CheckedListBox()
        self.chkListBox.Parent = self.form
        self.chkListBox.CheckOnClick = True
        self.chkListBox.Items.AddRange(self.inputs)
        self.chkListBox.Parent = self.form
        self.chkListBox.Location = Point(12*self.mul,45*self.mul)
        self.chkListBox.Size = Size(354*self.mul,340*self.mul)
        self.chkListBox.Anchor = (AnchorStyles.Bottom)|(AnchorStyles.Right)|(AnchorStyles.Top)|(AnchorStyles.Left)
        #checkbox
        self.chkBox = CheckBox()
        self.chkBox.Parent = self.form
        self.chkBox.CheckOnClick = True
        self.chkBox.Text = 'Select All'
        self.chkBox.Location = Point(12*self.mul, 403*self.mul)
        self.chkBox.Size = Size(113*self.mul,29*self.mul)
        self.chkBox.Anchor = (AnchorStyles.Bottom)|(AnchorStyles.Left)        
        #buttons
        self.button1 = Button()
        self.button1.Text = 'Confirm'
        self.button1.Name = 'Confirm'
        self.button1.Parent = self.form
        self.button1.Location = Point(136*self.mul,398*self.mul)
        self.button1.Size = Size(112*self.mul,34*self.mul)
        self.button1.Anchor = (AnchorStyles.Bottom)|(AnchorStyles.Right)
        
        self.button2 = Button()
        self.button2.Text = 'Cancel'
        self.button2.Name = 'Cancel'
        self.button2.Parent = self.form
        self.button2.Location = Point(254*self.mul,398*self.mul)
        self.button2.Size = Size(112*self.mul,34*self.mul)
        self.button2.Anchor = (AnchorStyles.Bottom)|(AnchorStyles.Right)
        
        #events
        
        self.form.Load += self.formLoadHandler
        self.button1.Click += self.buttonClickHandler
        self.button2.Click += self.buttonClickHandler        
        self.chkBox.CheckedChanged += self.chkStateEventHandler
    
    def Show(self):
        self.chkListBox.Items.AddRange(self.inputs)
        self.form.ShowDialog()
                
    def chkStateEventHandler(self, sender, args):
        if(sender.Checked):
            self.chkListBox.Enabled = False
            self.chkListBox.BackColor = SystemColors.ScrollBar
        else:
            self.chkListBox.Enabled = True
            self.chkListBox.BackColor = SystemColors.Window
   
        
    def keyPressHandler(self, sender, args):

        if (args.KeyCode == Keys.Enter):
           self.buttonClickHandler(self.button1, args)
		
    def buttonClickHandler(self, sender, args):
        if(sender.Name == 'Cancel'):
            self.form.Close()
        if(sender.Name == 'Confirm'):
            if self.chkBox.Checked:
                self.data = self.chkListBox.Items
            else:
                self.data = self.chkListBox.CheckedItems
            self.form.Close()

    def formLoadHandler(self, sender, args):
        sender.Text = 'Dynamo IFC-SG'



cf = CustomForm()
cf.inputs = sheetList
cf.Show()

outVal = []
for sheet in sheetList:
    if sheet in cf.data:
        outVal.append(sheet)

 

OUT = outVal
# ----------------------------------------
code_block = CodeBlock { false; }
importExcel = Data.ImportExcel(file=file_from_path, sheetName=windows_form_select_sheet, readAsStrings=code_block, showExcel=code_block)
python_script = Python(IN[0]=importExcel)  # CPython3
# ---------- python_script.python (54 lines) ----------
import clr

clr.AddReference('RevitAPI')
from Autodesk.Revit.DB import *

clr.AddReference('RevitAPIUI')
from Autodesk.Revit.UI import *

clr.AddReference('RevitNodes')
import Revit
clr.ImportExtensions(Revit.GeometryConversion)
clr.ImportExtensions(Revit.Elements)

clr.AddReference('RevitServices')
from RevitServices.Persistence import DocumentManager
import RevitServices
from RevitServices.Transactions import TransactionManager


def Unwrap(item):
    result = []
    if isinstance (item, list):
        for i in item:
            result.append(Unwrap(i))
    else:
        result = UnwrapElement(item)
    return result


doc = DocumentManager.Instance.CurrentDBDocument
uidoc=DocumentManager.Instance.CurrentUIApplication.ActiveUIDocument

#Preparing input from dynamo to revit
if isinstance(IN[0], list):
    data = [Unwrap(e) for e in IN[0]]
else:
    data = [Unwrap(IN[0])]
outVal = []
for subData in data:
    dicList = []
    keys = subData[0]
    valueSet = [d for i, d in enumerate(subData) if i != 0]
    for values in valueSet:
        dic = dict()
        for i, value in enumerate(values):
            if value is not None:
                dic[keys[i]] = value
        dicList.append(dic)
    outVal.append(dicList)
#Do some action in a Transaction
TransactionManager.Instance.EnsureInTransaction(doc)

TransactionManager.Instance.TransactionTaskDone()
OUT = outVal
# ----------------------------------------
python_script_2 = Python(IN[0]=python_script)  # CPython3
# ---------- python_script_2.python (102 lines) ----------
import clr

clr.AddReference('RevitAPI')
from Autodesk.Revit.DB import *

clr.AddReference('RevitAPIUI')
from Autodesk.Revit.UI import *

clr.AddReference('System')
from System.Collections.Generic import List

clr.AddReference('RevitNodes')
import Revit
clr.ImportExtensions(Revit.GeometryConversion)
clr.ImportExtensions(Revit.Elements)

clr.AddReference('RevitServices')
from RevitServices.Persistence import DocumentManager
import RevitServices
from RevitServices.Transactions import TransactionManager


def Unwrap(item):
    result = []
    if isinstance (item, list):
        for i in item:
            result.append(Unwrap(i))
    else:
        result = UnwrapElement(item)
    return result


doc = DocumentManager.Instance.CurrentDBDocument
uidoc=DocumentManager.Instance.CurrentUIApplication.ActiveUIDocument

#Preparing input from dynamo to revit
if isinstance(IN[0], list):
    data = IN[0]
else:
    data = [IN[0]]
outVal = []



for dicList in data:
    for dic in dicList:
        element = doc.GetElement(ElementId(dic["ElementId"]))
        if element is None :
            continue
        elementType = doc.GetElement(element.GetTypeId())
        parameters = []
        hasValueChanged = False
        for key in dic:
            if key == "ElementId":
                continue
            parameter = element.LookupParameter(key)
            if parameter is None:
                parameter = elementType.LookupParameter(key)
            type = parameter.StorageType
            valueToChange = None
            valueExisting = None
            if type == StorageType.Double:
                valueToChange = UnitUtils.ConvertToInternalUnits(float(dic[key]), parameter.GetUnitTypeId())
                valueExisting = parameter.AsDouble()
            elif type == StorageType.Integer:
                if int(dic[key]) == "No":
                    valueToChange = 0
                elif int(dic[key]) == "Yes":
                    valueToChange = 1
                else:
                    valueToChange = int(dic[key])
                valueExisting = parameter.AsInteger()

            elif type == StorageType.String:
                if dic[key] == None:
                    valueToChange = None
                else:
                    valueToChange = str(dic[key])
                if parameter.AsString() == None:
                    valueExisting = None
                else:  
                    valueExisting = parameter.AsString()
                    
            TransactionManager.Instance.EnsureInTransaction(doc)
            if(valueToChange != valueExisting):
                #CheckIf dataType is Bool
                hasValueChanged = True
                if parameter.Definition.GetDataType().TypeId == SpecTypeId.Boolean.YesNo.TypeId:
                    parameter.Set(valueToChange)
                elif type == StorageType.Double or type == StorageType.Integer:
                    parameter.Set(valueToChange)
                elif type == StorageType.ElementId: 
                    pass
                else: 
                    parameter.Set(valueToChange)
            TransactionManager.Instance.TransactionTaskDone()

        if hasValueChanged:
            outVal.append(element)


OUT = outVal
# ----------------------------------------
